# Grasshopper definition xmlTest.ghx (Grasshopper 1.0.7)

panel = Panel("this is panel!!")
customrandom = CustomRandom(num="10")  # -> out, ret
# ---------- customrandom: Python ----------
"""Provides a scripting component.
    Inputs:
        range: The range of values.
        num: The number of values.
        seed: Fixed seed for debugging.
    Output:
        ret: The a output variable"""

__author__ = "kado"
__version__ = "2021.08.25"

import rhinoscriptsyntax as rs
import random
import ghpythonlib.components as ghc
if not range:
    range = "0.0 to 1.0"
if seed:
    s = seed
else:
    s = random.randint(0, 10000)
ret = ghc.Random(range, num, int(s))
# ---------- end customrandom ----------
ma = MassAddition(Input=["3", "10"])  # -> Result, PartialResults
addition = Addition(A="3", B=flatten("10"))
larger = LargerThan(FirstNumber="3", SecondNumber=0)  # -> LargerThan, OrEqualTo
panel_2 = Panel(addition)
panel_3 = Panel([larger.LargerThan, addition])
add = GhPythonScript(x="3", y="10")  # -> out, a; inputs x: Int32, y: Int32
# ---------- add: Python ----------
__author__ = "kado"
__version__ = "2021.11.12"

import rhinoscriptsyntax as rs

a = x * y
# ---------- end add ----------
add_2 = GhPythonScript(x="3", y="10")  # -> out, a; inputs x: Int32, y: Int32
# ---------- add_2: Python ----------
__author__ = "kado"
__version__ = "2021.11.12"

import rhinoscriptsyntax as rs

a = x + y
# ---------- end add_2 ----------
aaa = Panel(add_2.a)
bbb = Panel(customrandom.ret)
